# Grasshopper definition A2.gh (Grasshopper 1.0.7)

number_slider = Slider(2.927, range=0..10)
number_slider_2 = Slider(30, range=0..100)
multiplication = Multiplication(A=number_slider, B=2)
division = Division(A=number_slider_2, B=2)
division_2 = Division(A=number_slider_2, B=3)
multiplication_2 = Multiplication(A=number_slider, B=1.5)
number_slider_3 = Slider(2, range=-2..4)
vector_xyz = VectorXYZ(XComponent=multiplication, YComponent=0, ZComponent=0)  # -> Vector, Length
rectangle = Rectangle(Plane=PlaneXY(0, 0, 0), XSize=number_slider, YSize=division_2, Radius=0)  # -> Rectangle, Length
addition = Addition(A=number_slider_2, B=division_2)
subtraction = Subtraction(A=division, B=multiplication_2)
linear_array = LinearArray(Geometry=rectangle.Rectangle, Direction=vector_xyz.Vector, Count=number_slider_3)  # -> Geometry, Transform
number_slider_4 = Slider(0.676, range=-1..1)
multiplication_3 = Multiplication(A=number_slider_4, B=2)
subtraction_2 = Subtraction(A=number_slider_2, B=number_slider_4)
rotate_direction = RotateDirection(Geometry=rectangle.Rectangle, Center=Point(0, 0, 0), From=Vector(1, 0, 0), To=Vector(0, 1, 0))  # -> Geometry, Transform
subtraction_3 = Subtraction(A=addition, B=multiplication_3)
subtraction_4 = Subtraction(A=number_slider_2, B=number_slider)
vector_xyz_2 = VectorXYZ(XComponent=subtraction, YComponent=subtraction_2, ZComponent=0)  # -> Vector, Length
division_3 = Division(A=subtraction_4, B=2)
multiplication_4 = Multiplication(A=subtraction_3, B=-1)
vector_xyz_3 = VectorXYZ(XComponent=number_slider_4, YComponent=0, ZComponent=0)  # -> Vector, Length
vector_xyz_4 = VectorXYZ(XComponent=0, YComponent=division_3, ZComponent=0)  # -> Vector, Length
vector_xyz_5 = VectorXYZ(XComponent=0, YComponent=multiplication_4, ZComponent=0)  # -> Vector, Length
move = Move(Geometry=rotate_direction.Geometry, Motion=vector_xyz_3.Vector)  # -> Geometry, Transform
vector_xyz_6 = VectorXYZ(XComponent=subtraction_3, YComponent=0, ZComponent=0)  # -> Vector, Length
move_2 = Move(Geometry=move.Geometry, Motion=vector_xyz_4.Vector)  # -> Geometry, Transform
move_3 = Move(Geometry=linear_array.Geometry, Motion=vector_xyz_2.Vector)  # -> Geometry, Transform
linear_array_2 = LinearArray(Geometry=move_2.Geometry, Direction=vector_xyz_6.Vector, Count=number_slider_3)  # -> Geometry, Transform
linear_array_3 = LinearArray(Geometry=move_3.Geometry, Direction=vector_xyz_5.Vector, Count=number_slider_3)  # -> flatten(Geometry), Transform
rectangle_2 = Rectangle(Plane=PlaneXY(0, 0, 0), XSize=number_slider_2, YSize=number_slider_2, Radius=0)  # -> Rectangle, Length
multiplication_5 = Multiplication(A=division_2, B=2)
addition_2 = Addition(A=multiplication_5, B=number_slider_2)
trim_with_regions = TrimWithRegions(Curve=linear_array_2.Geometry, Regions=rectangle_2.Rectangle)  # -> Inside, Outside
trim_with_regions_2 = TrimWithRegions(Curve=rectangle_2.Rectangle, Regions=linear_array_2.Geometry)  # -> Inside, Outside
addition_3 = Addition(A=addition_2, B=5)
join_curves = JoinCurves(Curves=[trim_with_regions.Outside, trim_with_regions_2.Outside], Preserve=False)
trim_with_regions_3 = TrimWithRegions(Curve=linear_array_3.Geometry, Regions=rectangle_2.Rectangle)  # -> Inside, flatten(Outside)
trim_with_regions_4 = TrimWithRegions(Curve=join_curves, Regions=linear_array_3.Geometry)  # -> Inside, flatten(Outside)
join_curves_2 = JoinCurves(Curves=[trim_with_regions_3.Outside, trim_with_regions_4.Outside], Preserve=False)  # -> flatten(Curves)
surface = Surface(join_curves_2)
vector_xyz_7 = VectorXYZ(XComponent=0, YComponent=0, ZComponent=number_slider)  # -> Vector, Length
extrude = Extrude(Base=surface, Direction=vector_xyz_7.Vector)
rectangle_3 = Rectangle(Plane=PlaneXY(0, 0, 0), XSize=addition_3, YSize=addition_3, Radius=0)  # -> Rectangle, Length
cap_holes = CapHoles(Brep=extrude)
rectangular_array = RectangularArray(Geometry=cap_holes, Cell=rectangle_3.Rectangle, XCount=Slider(8, range=0..10), YCount=Slider(4, range=0..10))  # -> Geometry, Transform
