# Grasshopper definition 4Pieces.gh (Grasshopper 1.0.7)

xy = XYPlane(Origin=Point(0, 0, 0))
number_slider = Slider(60, range=0..100)
rectangle = Rectangle(Plane=xy, XSize=number_slider, YSize=number_slider, Radius=0)  # -> Rectangle, Length
explode = Explode(Curve=rectangle.Rectangle, Recursive=True)  # -> Segments, Vertices
item = ListItem(List=explode.Segments, Index=Slider(3, range=0..10), Wrap=True)
divide = DivideCurve(Curve=item, Count=Slider(13, range=0..30), Kinks=False)  # -> Points, Tangents, Parameters
number_slider_2 = Slider(6.35, range=0..10)
shatter = Shatter(Curve=item, Parameters=divide.Parameters)
X = UnitX(Factor=number_slider_2)
move = Move(Geometry=shatter, Motion=X)  # -> Geometry, Transform
expression = Expression(x=X, Expression="-x*2")
area = Area(Geometry=rectangle.Rectangle)  # -> Area, Centroid
extr = Extrude(Base=move.Geometry, Direction=expression)
number_slider_3 = Slider(9, range=0..10)
addition = Addition(A=number_slider_3, B=number_slider_2)
addition_2 = Addition(A=addition, B=number_slider_3)
X_2 = UnitX(Factor=number_slider)
subtraction = Subtraction(A=number_slider, B=addition_2)
Z = UnitZ(Factor=number_slider_2)
dispatch = Dispatch(List=extr, DispatchPattern=[True, False])  # -> ListA, ListB
Z_2 = UnitZ(Factor=addition)
move_2 = Move(Geometry=dispatch.ListB, Motion=X_2)  # -> Geometry, Transform
Z_3 = UnitZ(Factor=subtraction)
rectangle_2 = Rectangle(Plane=PlaneXY(0, 0, 0), XSize=number_slider_3, YSize=Slider(6.3, range=0..10), Radius=0)  # -> Rectangle, Length
merge = Merge(Data1=dispatch.ListA, Data2=move_2.Geometry)
vec = VectorXYZ(XComponent=Z_3, YComponent=Z, ZComponent=0)  # -> Vector, Length
dup = DuplicateData(Data=rectangle_2.Rectangle, Number=Slider(2, range=0..10), Order=True)
vec_2 = VectorXYZ(XComponent=Z_2, YComponent=Z, ZComponent=0)  # -> Vector, Length
rdiff = RegionDifference(CurvesA=rectangle.Rectangle, CurvesB=merge)
move_3 = Move(Geometry=dup, Motion=vec_2.Vector)  # -> Geometry, Transform
move_4 = Move(Geometry=dup, Motion=vec.Vector)  # -> Geometry, Transform
merge_2 = Merge(Data1=move_3.Geometry, Data2=move_4.Geometry)
rdiff_2 = RegionDifference(CurvesA=rdiff, CurvesB=merge_2)
boundary = BoundarySurfaces(Edges=rdiff_2)
addition_3 = Addition(A=number_slider, B=Slider(5, range=0..10))
number_slider_4 = Slider(2, range=0..10)
rectangle_3 = Rectangle(Plane=PlaneXY(0, 0, 0), XSize=addition_3, YSize=addition_3, Radius=0)  # -> Rectangle, Length
arrrec = RectangularArray(Geometry=boundary, Cell=rectangle_3.Rectangle, XCount=number_slider_4, YCount=number_slider_4)  # -> Geometry, Transform
